# Grasshopper definition GHtoSUO_add_records_to_sales.gh (Grasshopper 1.0.7)
# plug-ins: Swiftlet

# Create a panel that can look like Sales/More in SUO.
# The names of entities are assigned with JSON ID of entity: example: SuperOffice:13
# The mapping is in the file
# In the panel you can choose for each entity a list of Colors/Material/etc.
# There are files translating each color to ID for JSON, each entity has its file, some entities use same file.
panel = Panel("\"SuperOffice:1\":")
concatenate = Concatenate(Fragment_A="\"[", Fragment_B="F:77.77", A="]\",")
# How to add more records to the JSON file string while choosing many entities simuntaneously?
# Programming logic ?(IF record THEN add)
panel_2 = Panel("""{
"UserDefinedFields": {""")
panel_3 = Panel(""" }
}""")
concatenate_2 = Concatenate(Fragment_A=panel_2, Fragment_B=panel, A=concatenate, B=panel_3)
panel_4 = Panel(concatenate_2)
panel_5 = Panel("""{
  "UserDefinedFields": {
    "SuperOffice:1": "[F:44.33]"
  }
}""")
bearer_token_auth = BearerTokenAuth(Token="8A:Cust29326.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")
create_text_body_custom = CreateTextBodyCustom(Content=concatenate_2, ContentType="application/json")
create_query_param = CreateQueryParam(Key="$select", Value="UserDefinedFields")
patch_request = PATCHRequest(
    URL="https://online4.superoffice.com/Cust29326/api/v1/Sale/8667",
    Body=create_text_body_custom,
    Params=create_query_param,
    Headers=bearer_token_auth)  # -> Status, Content, Response
panel_6 = Panel(patch_request.Status)
format_json_string = FormatJsonString(JSONString=patch_request.Content)
panel_7 = Panel(format_json_string)
